# Grasshopper definition Tree block placer.gh (Grasshopper 1.0.7)
# plug-ins: Scatter, Pufferfish, Human, Kangaroo2 Components

pistaciaterebinthus_id = Guid(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)
quercusilexsmall_id = Guid(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)
# Alberto Ferrero
# Architect
# ferrero.arch@gmail.com
# linkedin.com/in/alberto-ferrero-de-la-vega-060341157
quercusilexbig_id = Guid(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)
quercussuber_id = Guid(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)
tree1_id = Guid(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)
tree2_id = Guid(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)
tree3_id = Guid(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)
tree4_id = Guid(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)
tree5_id = Guid(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)
tree6_id = Guid(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)
_1_quercusilexsmall_id = Guid(quercusilexsmall_id)
_2_quercussuber_id = Guid(quercussuber_id)
_3_pistaciaterebinthus_id = Guid(pistaciaterebinthus_id)
_4_tree1_id = Guid(tree1_id)
_5_tree2_id = Guid(tree2_id)
_6_tree3_id = Guid(tree3_id)
_7_tree4_id = Guid(tree4_id)
_8_tree5_id = Guid(tree5_id)
_9_tree6_id = Guid(tree6_id)
_0_quercusilexbig_id = Guid(quercusilexbig_id)
layer_name = Panel("Default")
seed = Slider(47, range=0..100)
dispersion = Slider(0.1, range=0.1..10)
count = Slider(62, range=0..250)

# ---- group: Change the relative amount of each specie
genes = GenePool(Decimals=2, Maximum=100, Minimum=0, Value=[13.39, 0, 36.17, 0, 69.32, 0, 56.93, 0, 100, 0])

# ----
pistaciaterebinthus_id_2 = Guid(pistaciaterebinthus_id)
quercusilexsmall_id_2 = Guid(quercusilexsmall_id)
quercusilexbig_id_2 = Guid(quercusilexbig_id)
quercussuber_id_2 = Guid(quercussuber_id)
tree1_id_2 = Guid(tree1_id)
tree2_id_2 = Guid(tree2_id)
tree3_id_2 = Guid(tree3_id)
tree4_id_2 = Guid(tree4_id)
tree6_id_2 = Guid(tree6_id)
tree5_id_2 = Guid(tree5_id)
merge = Merge(
    Data1=quercusilexbig_id_2,
    Data2=quercusilexsmall_id_2,
    Data3=quercussuber_id_2,
    Data4=pistaciaterebinthus_id_2,
    Data5=tree1_id_2,
    Data6=tree2_id_2,
    Data7=tree3_id_2,
    Data8=tree4_id_2,
    Data9=tree5_id_2,
    Data10=tree6_id_2)  # -> graft(Result)

layername_data = Data(layer_name)
count_num = Number(count)
seed_num = Number(seed)
dispersion_num = Number(dispersion)
dispersion_num_2 = Number(dispersion_num)
null = NullPlaceholder()
layername_data_2 = Data(layername_data)
seed_num_2 = Number(seed_num)
count_num_2 = Number(count_num)
python = GhPythonScript(x=genes, y=null)  # -> out, a
# ---------- python: Python ----------
__author__ = "aferr"
__version__ = "2023.01.21"

import rhinoscriptsyntax as rs
if x == 0:
    a = y
else:
    a = x
# ---------- end python ----------
dispersion_num_3 = Number(dispersion_num)
speciesprop_num = Number(python.a)
speciesprop_num_2 = Number(speciesprop_num)
clean = CleanTree(RemoveNulls=True, RemoveInvalid=True, RemoveEmpty=False, Tree=speciesprop_num_2)
ma = MassAddition(ListGenePool=clean)  # -> Result, PartialResults
dom = ConstructDomain(DomainStart=0, DomainEnd=ma.Result)
speciesprop_num_3 = Number(speciesprop_num)

# ---- group: Press to Insert Blocks
button = Button()

# ----
null_2 = NullItem(Item=speciesprop_num_3)  # -> NullFlags, InvalidFlags, Description
speciesprop_num_4 = Number(speciesprop_num)
cull = CullPattern(List=merge, CullPattern=invert(graft(null_2.InvalidFlags)))  # -> simplify(List)
cull_2 = CullPattern(List=merge, CullPattern=graft(null_2.InvalidFlags))  # -> simplify(List)
count_num_3 = Number(count_num)
clean_2 = CleanTree(RemoveNulls=True, RemoveInvalid=True, RemoveEmpty=True, Tree=cull)
clean_3 = CleanTree(RemoveNulls=True, RemoveInvalid=True, RemoveEmpty=False, Tree=cull_2)
replace = ReplaceItems(List=clean_3, Indices="0", Wrap=False)  # -> simplify(List)
merge_2 = Merge(Data1=clean_2, Data2=replace)  # -> simplify(Result)
seed_num_3 = Number(seed_num)
species_id = Guid(merge_2)
species_id_2 = Guid(species_id)
layername_data_3 = Data(layername_data)
dpipeline = DynamicGeometryPipeline(
    LayerFilter=layername_data_3,
    TypeFilter="Curve",
    NameFilter="*",
    GroupByLayer=False,
    GroupByType=False,
    IncludeHidden=True,
    IncludeLocked=True,
    enableFullPath=False,
    listenToAttributes=True)
dpipeline_2 = DynamicGeometryPipeline(
    LayerFilter=layername_data_3,
    TypeFilter="Point",
    NameFilter="*",
    GroupByLayer=False,
    GroupByType=False,
    IncludeHidden=True,
    IncludeLocked=True,
    enableFullPath=False,
    listenToAttributes=True)
guides_crv = Curve(dpipeline)
guides_crv_2 = Curve(guides_crv)
cls = Closed(Curve=guides_crv_2)  # -> Closed, Periodic
dispatch = Dispatch(List=guides_crv_2, DispatchPattern=cls.Periodic)  # -> ListA, ListB
addition = Addition(A=dispatch.ListB, B=0)
equals = Equality(FirstNumber=addition, SecondNumber=0)  # -> Equality, Inequality
crv = Curve(dispatch.ListA)
crv_2 = Curve(dispatch.ListB)
filter = StreamFilter(Gate=equals.Equality, Stream0=dispersion_num_2)
filter_2 = StreamFilter(Gate=equals.Equality, Stream0="2")
area = Area(Geometry=crv)  # -> Area, Centroid
len = Length(Curve=crv_2)
offcrv = OffsetCurve(Curve=crv_2, Plane=PlaneXY(0, 0, 0), Distance=filter, BothSides=expr("-x", filter), Kinks=0, CapType=1)
multiplication = Multiplication(A=len, B=filter, C=filter_2)
boundary = BoundarySurfaces(Edges=crv)
merge_3 = Merge(Data1=area.Area, Data2=multiplication)
ma_2 = MassAddition(Input=[area.Area, multiplication])  # -> Result, PartialResults
boundary_2 = BoundarySurfaces(Edges=offcrv)
dom_2 = ConstructDomain(DomainStart=0, DomainEnd=ma_2.Result)

area_2 = Area(Geometry=boundary)  # -> Area, Centroid
panel = Panel("10000")  # "M2/Ha"
division = Division(A=area_2.Area, B=panel)
panel_2 = Panel("40")  # "ud/Ha"
multiplication_2 = Multiplication(A=division, B=panel_2)

remap = RemapNumbers(Value=merge_3, Source=dom_2, Target="0 to 1")  # -> Mapped, Clipped
multiplication_3 = Multiplication(A=count_num_3, B=remap.Mapped)
round = Round(Number=multiplication_3)  # -> Nearest, Floor, Ceiling
item = ListItem(List=round.Nearest, Index=0, Wrap=True)  # -> Item, Item1
filter_3 = StreamFilter(Gate=Toggle(True), Stream0=multiplication_2, Stream1=item.Item)
popgeo = PopulateGeometry(Geometry=boundary, Count=filter_3, Seed=1)
popgeo_2 = PopulateGeometry(Geometry=boundary_2, Count=item.Item1, Seed=1)
points_pt = Point(dpipeline_2)
points_pt_2 = Point(points_pt)
merge_4 = Merge(Data1=popgeo, Data2=popgeo_2, Data3=points_pt_2)  # -> flatten(Result)
duppt = RemoveDuplicatePts(Points=merge_4, Tolerance=Slider(3.74, range=0.01..5))
allpoints_pt = Point(duppt)
allpoints_pt_2 = Point(allpoints_pt)
lng = ListLength(PlacingPoints=allpoints_pt_2)
dom_3 = ConstructDomain(DomainStart=0, DomainEnd=lng)
remap_2 = RemapNumbers(Value=speciesprop_num_2, Source=dom, Target=dom_3)  # -> Mapped, Clipped
round_2 = Round(Number=remap_2.Mapped)  # -> Nearest, Floor, Ceiling
clean_4 = CleanTree(RemoveNulls=True, RemoveInvalid=True, RemoveEmpty=False, Tree=round_2.Nearest)
ma_3 = MassAddition(Input=clean_4)  # -> Result, PartialResults
subtraction = Subtraction(A=ma_3.Result, B=lng)
item_2 = ListItem(List=round_2.Nearest, Index="0", Wrap=True)
series = Series(Start=0, Step=1, Count=lng)
subtraction_2 = Subtraction(A=item_2, B=subtraction)
replace_2 = ReplaceItems(List=round_2.Nearest, Item=subtraction_2, Indices="0", Wrap=False)
jitter = Jitter(List=series, Jitter=1, Seed=seed_num_3)  # -> Values, Indices
partition = PartitionList(List=jitter.Values, Size=replace_2)  # -> simplify(Chunks)
item_3 = ListItem(List=allpoints_pt_2, Index=partition, Wrap=True)
pointsinorder_pt = Point(item_3)

preview = Preview(True)
species_id_3 = Guid(species_id)
pointsinorder_pt_2 = Point(pointsinorder_pt)
scatter = Scatter(
    GeometryAsGuid=species_id_3,
    TargetPlanes=pointsinorder_pt_2,
    RotationMin=Slider(180, range=0..180),
    ScaleXMin=Slider(0.9, range=0..10),
    ScaleYMin=Slider(0.9, range=0..10),
    ScaleZMin=Slider(0.9, range=0..10),
    RotationMax=Slider(180, range=0..180),
    ScaleXMax=Slider(1.3, range=0..10),
    ScaleYMax=Slider(1.3, range=0..10),
    ScaleZMax=Slider(1.3, range=0..10),
    Seed=Slider(0, range=0..10),
    Preview=preview,
    Activate=button)

pointsinorder_pt_3 = Point(pointsinorder_pt)
guides_crv_3 = Curve(guides_crv)
points_pt_3 = Point(points_pt)
allpoints_pt_3 = Point(allpoints_pt)
